# Grasshopper definition gpt_4_Bridge_001.gh (Grasshopper 1.0.7)
# Copyright: © 2017-2022 Pierre Cuvilliers, Caitlin Mueller, Massachusetts Institute of Technology
# plug-ins: Bifocals, Hops, ScriptParasite

# GPT-4 and the GhPython Node at
# www.wickersonstudios.com
number_slider = Slider(100, range=0..100)
create_cylinder_bridge = GhPythonScript(
    length=Slider(99.32, range=0..100),
    width=Slider(13.25, range=0..100),
    height=Slider(24.76, range=0..100),
    divisions=Slider(10, range=0..10),
    pillar_radius=Slider(1, range=0..100),
    beam_radius=Slider(0.5, range=0..100),
    road_thickness=Slider(0.5, range=0..100))  # -> out, a; inputs divisions: Int32
# ---------- create_cylinder_bridge: Python ----------
import Rhino
import math
import scriptcontext
import rhinoscriptsyntax as rs

def create_cylinder_bridge(length, width, height, divisions, pillar_radius, beam_radius, road_thickness):
    # Calculate division length
    div_length = length / divisions
    
    # Initialize list for bridge components
    bridge = []
    
    # Create cylinders for the bridge
    for i in range(divisions):
        x = i * div_length
        base_point = Rhino.Geometry.Point3d(x, width/2, 0)
        
        # Create cylinder
        base_circle = Rhino.Geometry.Circle(base_point, pillar_radius)
        cylinder = Rhino.Geometry.Cylinder(base_circle, height)
        
        # Add cylinder to bridge
        bridge.append(cylinder.ToBrep(True, True))

        # If it's not the first or last division, create the beam between pillars
        if i > 0:
            start_point = Rhino.Geometry.Point3d(x - div_length, width/2, height)
            end_point = Rhino.Geometry.Point3d(x, width/2, height)
            line = Rhino.Geometry.Line(start_point, end_point)

            # Calculate midpoint of the line
            midpoint = Rhino.Geometry.Point3d((start_point.X + end_point.X) / 2, (start_point.Y + end_point.Y) / 2, (start_point.Z + end_point.Z) / 2)

            beam = Rhino.Geometry.Cylinder(Rhino.Geometry.Circle(midpoint, beam_radius), line.Length)
            
            # Add beam to bridge
            bridge.append(beam.ToBrep(True, True))
    
    # Create the road on the top of the pillars
    road_height = height + road_thickness
    road_base = Rhino.Geometry.Point3d(0, 0, height)
    road_points = [
        Rhino.Geometry.Point3d(road_base[0], road_base[1], road_base[2]),
        Rhino.Geometry.Point3d(road_base[0] + length, road_base[1], road_base[2]),
        Rhino.Geometry.Point3d(road_base[0] + length, road_base[1] + width, road_base[2]),
        Rhino.Geometry.Point3d(road_base[0], road_base[1] + width, road_base[2]),
        Rhino.Geometry.Point3d(road_base[0], road_base[1], road_base[2] + road_thickness),
        Rhino.Geometry.Point3d(road_base[0] + length, road_base[1], road_base[2] + road_thickness),
        Rhino.Geometry.Point3d(road_base[0] + length, road_base[1] + width, road_base[2] + road_thickness),
        Rhino.Geometry.Point3d(road_base[0], road_base[1] + width, road_base[2] + road_thickness),
    ]

    # Create road
    road = Rhino.Geometry.Brep.CreateFromBox(road_points)
    
    # Add road to bridge
    bridge.append(road)
    
    # Return bridge components
    return bridge

# Create a cylinder bridge
bridge = create_cylinder_bridge(100, 10, 20, 10, 1, 0.5, 0.5)

# Output the bridge
a = bridge
# ---------- end create_cylinder_bridge ----------
create_cylinder_bridge_2 = GhPythonScript(
    length=Slider(99.32, range=0..100),
    width=Slider(13.25, range=0..100),
    height=Slider(24.76, range=0..100),
    divisions=Slider(10, range=0..10),
    pillar_radius=Slider(1, range=0..100),
    beam_radius=Slider(0.5, range=0..100))  # -> out, a; inputs divisions: Int32
# ---------- create_cylinder_bridge_2: Python ----------
import Rhino
import math
import scriptcontext
import rhinoscriptsyntax as rs

def create_cylinder_bridge(length, width, height, divisions, pillar_radius, beam_radius):
    # Calculate division length
    div_length = length / divisions
    
    # Initialize list for bridge components
    bridge = []
    
    # Create cylinders for the bridge
    for i in range(divisions):
        x = i * div_length
        base_point = Rhino.Geometry.Point3d(x, width/2, 0)
        
        # Create cylinder
        base_circle = Rhino.Geometry.Circle(base_point, pillar_radius)
        cylinder = Rhino.Geometry.Cylinder(base_circle, height)
        
        # Add cylinder to bridge
        bridge.append(cylinder.ToBrep(True, True))

        # If it's not the first or last division, create the beam between pillars
        if i > 0:
            start_point = Rhino.Geometry.Point3d(x - div_length, width/2, height)
            end_point = Rhino.Geometry.Point3d(x, width/2, height)
            line = Rhino.Geometry.Line(start_point, end_point)

            # Calculate midpoint of the line
            midpoint = Rhino.Geometry.Point3d((start_point.X + end_point.X) / 2, (start_point.Y + end_point.Y) / 2, (start_point.Z + end_point.Z) / 2)

            beam = Rhino.Geometry.Cylinder(Rhino.Geometry.Circle(midpoint, beam_radius), line.Length)
            
            # Add beam to bridge
            bridge.append(beam.ToBrep(True, True))
    
    # Return bridge components
    return bridge

# Create a cylinder bridge
bridge = create_cylinder_bridge(length, width, height, divisions, pillar_radius, beam_radius)

# Output the bridge
a = bridge
# ---------- end create_cylinder_bridge_2 ----------
create_box_bridge = GhPythonScript(length=number_slider, width=Slider(10, range=0..100), height=Slider(20, range=0..100), divisions=Slider(10, range=0..10))  # -> out, a; inputs divisions: Int32
# ---------- create_box_bridge: Python ----------
import Rhino
import math
import scriptcontext
import rhinoscriptsyntax as rs

def create_box_bridge(length, width, height, divisions):
    # Calculate division length
    div_length = length / divisions
    
    # Initialize list for bridge components
    bridge = []
    
    # Create boxes for the bridge
    for i in range(divisions):
        x = i * div_length
        box_base = Rhino.Geometry.Point3d(x, 0, 0)
        box_length = div_length
        box_width = width
        box_height = height
        
        # Create corners for box
        box_corners = [
            Rhino.Geometry.Point3d(box_base[0], box_base[1], box_base[2]),
            Rhino.Geometry.Point3d(box_base[0] + box_length, box_base[1], box_base[2]),
            Rhino.Geometry.Point3d(box_base[0] + box_length, box_base[1] + box_width, box_base[2]),
            Rhino.Geometry.Point3d(box_base[0], box_base[1] + box_width, box_base[2]),
            Rhino.Geometry.Point3d(box_base[0], box_base[1], box_base[2] + box_height),
            Rhino.Geometry.Point3d(box_base[0] + box_length, box_base[1], box_base[2] + box_height),
            Rhino.Geometry.Point3d(box_base[0] + box_length, box_base[1] + box_width, box_base[2] + box_height),
            Rhino.Geometry.Point3d(box_base[0], box_base[1] + box_width, box_base[2] + box_height),
        ]
        
        # Create box
        box = Rhino.Geometry.Brep.CreateFromBox(box_corners)
        
        # Add box to bridge
        bridge.append(box)
    
    # Return bridge components
    return bridge

# Create a box bridge
bridge = create_box_bridge(100, 10, 20, 10)

# Output the bridge
a = bridge
# ---------- end create_box_bridge ----------
create_cylinder_bridge_3 = GhPythonScript(
    length=Slider(100, range=0..100),
    width=Slider(15.97, range=0..100),
    height=Slider(9.8, range=0..100),
    divisions=Slider(10, range=0..10),
    pillar_radius=Slider(1, range=0..100),
    beam_radius=Slider(0.5, range=0..100),
    road_thickness=Slider(0.5, range=0..100),
    railing_height=Slider(1.72, range=0..3),
    railing_thickness=Slider(0.55, range=0..3),
    catenary_height=Slider(9.12, range=0..10))  # -> out, a; inputs divisions: Int32
# ---------- create_cylinder_bridge_3: Python ----------
import Rhino
import math
import scriptcontext
import rhinoscriptsyntax as rs

def create_cylinder_bridge(length, width, height, divisions, pillar_radius, beam_radius, road_thickness, railing_height, railing_thickness):
    # Calculate division length
    div_length = length / divisions
    
    # Initialize list for bridge components
    bridge = []
    
    # Create cylinders for the bridge
    for i in range(divisions):
        x = i * div_length
        base_point = Rhino.Geometry.Point3d(x, width/2, 0)
        
        # Create cylinder
        base_circle = Rhino.Geometry.Circle(base_point, pillar_radius)
        cylinder = Rhino.Geometry.Cylinder(base_circle, height)
        
        # Add cylinder to bridge
        bridge.append(cylinder.ToBrep(True, True))

        # If it's not the first or last division, create the beam between pillars
        if i > 0:
            start_point = Rhino.Geometry.Point3d(x - div_length, width/2, height)
            end_point = Rhino.Geometry.Point3d(x, width/2, height)
            line = Rhino.Geometry.Line(start_point, end_point)

            # Calculate midpoint of the line
            midpoint = Rhino.Geometry.Point3d((start_point.X + end_point.X) / 2, (start_point.Y + end_point.Y) / 2, (start_point.Z + end_point.Z) / 2)

            beam = Rhino.Geometry.Cylinder(Rhino.Geometry.Circle(midpoint, beam_radius), line.Length)
            
            # Add beam to bridge
            bridge.append(beam.ToBrep(True, True))
    
    # Create the road on the top of the pillars
    road_height = height + road_thickness
    road_base = Rhino.Geometry.Point3d(0, 0, height)
    road_points = [
        Rhino.Geometry.Point3d(road_base[0], road_base[1], road_base[2]),
        Rhino.Geometry.Point3d(road_base[0] + length, road_base[1], road_base[2]),
        Rhino.Geometry.Point3d(road_base[0] + length, road_base[1] + width, road_base[2]),
        Rhino.Geometry.Point3d(road_base[0], road_base[1] + width, road_base[2]),
        Rhino.Geometry.Point3d(road_base[0], road_base[1], road_base[2] + road_thickness),
        Rhino.Geometry.Point3d(road_base[0] + length, road_base[1], road_base[2] + road_thickness),
        Rhino.Geometry.Point3d(road_base[0] + length, road_base[1] + width, road_base[2] + road_thickness),
        Rhino.Geometry.Point3d(road_base[0], road_base[1] + width, road_base[2] + road_thickness),
    ]

    # Create road
    road = Rhino.Geometry.Brep.CreateFromBox(road_points)
    
    # Add road to bridge
    bridge.append(road)

    # Create railings
    railing_base_height = height + road_thickness
    railing_top_height = railing_base_height + railing_height

    # Left railing
    left_railing_start = Rhino.Geometry.Point3d(0, railing_thickness / 2, railing_base_height)
    left_railing_end = Rhino.Geometry.Point3d(length, railing_thickness / 2, railing_base_height)
    left_railing_line = Rhino.Geometry.Line(left_railing_start, left_railing_end)
    left_railing_midpoint = left_railing_line.PointAt(0.5)
    left_railing = Rhino.Geometry.Cylinder(Rhino.Geometry.Circle(left_railing_midpoint, railing_thickness / 2), railing_height)
    bridge.append(left_railing.ToBrep(True, True))
    
    # Right railing
    right_railing_start = Rhino.Geometry.Point3d(0, width - railing_thickness / 2, railing_base_height)
    right_railing_end = Rhino.Geometry.Point3d(length, width - railing_thickness / 2, railing_base_height)
    right_railing_line = Rhino.Geometry.Line(right_railing_start, right_railing_end)
    right_railing_midpoint = right_railing_line.PointAt(0.5)
    right_railing = Rhino.Geometry.Cylinder(Rhino.Geometry.Circle(right_railing_midpoint, railing_thickness / 2), railing_height)
    bridge.append(right_railing.ToBrep(True, True))

    # Define number of railing segments
    railing_segments = 10
    
    # Calculate the length of each segment
    segment_length = length / railing_segments
    
    # Create railings
    for i in range(railing_segments):
        x = i * segment_length
        
        # Left railing
        left_railing_start = Rhino.Geometry.Point3d(x, railing_thickness / 2, railing_base_height)
        left_railing_end = Rhino.Geometry.Point3d(x + segment_length, railing_thickness / 2, railing_base_height)
        left_railing_line = Rhino.Geometry.Line(left_railing_start, left_railing_end)
        left_railing_midpoint = left_railing_line.PointAt(0.5)
        left_railing = Rhino.Geometry.Cylinder(Rhino.Geometry.Circle(left_railing_midpoint, railing_thickness / 2), railing_height)
        bridge.append(left_railing.ToBrep(True, True))
        
        # Right railing
        right_railing_start = Rhino.Geometry.Point3d(x, width - railing_thickness / 2, railing_base_height)
        right_railing_end = Rhino.Geometry.Point3d(x + segment_length, width - railing_thickness / 2, railing_base_height)
        right_railing_line = Rhino.Geometry.Line(right_railing_start, right_railing_end)
        right_railing_midpoint = right_railing_line.PointAt(0.5)
        right_railing = Rhino.Geometry.Cylinder(Rhino.Geometry.Circle(right_railing_midpoint, railing_thickness / 2), railing_height)
        bridge.append(right_railing.ToBrep(True, True))

    # Create catenary arch cables
    for i in range(divisions - 1):
        x_start = i * div_length
        x_end = (i + 1) * div_length
    
        start_point = Rhino.Geometry.Point3d(x_start, width / 2, height + road_thickness)
        end_point = Rhino.Geometry.Point3d(x_end, width / 2, height + road_thickness)
    
        # Define the catenary height (adjust this to get desired catenary shape)
        #catenary_height = 2  # arbitrary value
    
        # Create the points for the catenary curve
        catenary_points = [
            start_point,
            Rhino.Geometry.Point3d((x_start + x_end) / 2, width / 2, height + road_thickness + catenary_height),
            end_point,
        ]
    
        # Create the catenary curve
        catenary_curve = Rhino.Geometry.Curve.CreateInterpolatedCurve(catenary_points, 3)
        
        # Add curve to bridge
        bridge.append(catenary_curve.ToNurbsCurve())



    # Return bridge components
    return bridge

# Create a cylinder bridge with railings
bridge = create_cylinder_bridge(length, width, height, divisions, pillar_radius, beam_radius, road_thickness, railing_height, railing_thickness)

# Output the bridge
a = bridge
# ---------- end create_cylinder_bridge_3 ----------
create_cylinder_bridge_4 = GhPythonScript(
    length=Slider(100, range=0..100),
    width=Slider(18.01, range=0..100),
    height=Slider(11.16, range=0..100),
    divisions=Slider(10, range=0..10),
    pillar_radius=Slider(1, range=0..100),
    beam_radius=Slider(0.5, range=0..100),
    road_thickness=Slider(0.5, range=0..100),
    railing_height=Slider(1.72, range=0..3),
    railing_thickness=Slider(0.55, range=0..3))  # -> out, a; inputs divisions: Int32
# ---------- create_cylinder_bridge_4: Python ----------
import Rhino
import math
import scriptcontext
import rhinoscriptsyntax as rs

def create_cylinder_bridge(length, width, height, divisions, pillar_radius, beam_radius, road_thickness, railing_height, railing_thickness):
    # Calculate division length
    div_length = length / divisions
    
    # Initialize list for bridge components
    bridge = []
    
    # Create cylinders for the bridge
    for i in range(divisions):
        x = i * div_length
        base_point = Rhino.Geometry.Point3d(x, width/2, 0)
        
        # Create cylinder
        base_circle = Rhino.Geometry.Circle(base_point, pillar_radius)
        cylinder = Rhino.Geometry.Cylinder(base_circle, height)
        
        # Add cylinder to bridge
        bridge.append(cylinder.ToBrep(True, True))

        # If it's not the first or last division, create the beam between pillars
        if i > 0:
            start_point = Rhino.Geometry.Point3d(x - div_length, width/2, height)
            end_point = Rhino.Geometry.Point3d(x, width/2, height)
            line = Rhino.Geometry.Line(start_point, end_point)

            # Calculate midpoint of the line
            midpoint = Rhino.Geometry.Point3d((start_point.X + end_point.X) / 2, (start_point.Y + end_point.Y) / 2, (start_point.Z + end_point.Z) / 2)

            beam = Rhino.Geometry.Cylinder(Rhino.Geometry.Circle(midpoint, beam_radius), line.Length)
            
            # Add beam to bridge
            bridge.append(beam.ToBrep(True, True))
    
    # Create the road on the top of the pillars
    road_height = height + road_thickness
    road_base = Rhino.Geometry.Point3d(0, 0, height)
    road_points = [
        Rhino.Geometry.Point3d(road_base[0], road_base[1], road_base[2]),
        Rhino.Geometry.Point3d(road_base[0] + length, road_base[1], road_base[2]),
        Rhino.Geometry.Point3d(road_base[0] + length, road_base[1] + width, road_base[2]),
        Rhino.Geometry.Point3d(road_base[0], road_base[1] + width, road_base[2]),
        Rhino.Geometry.Point3d(road_base[0], road_base[1], road_base[2] + road_thickness),
        Rhino.Geometry.Point3d(road_base[0] + length, road_base[1], road_base[2] + road_thickness),
        Rhino.Geometry.Point3d(road_base[0] + length, road_base[1] + width, road_base[2] + road_thickness),
        Rhino.Geometry.Point3d(road_base[0], road_base[1] + width, road_base[2] + road_thickness),
    ]

    # Create road
    road = Rhino.Geometry.Brep.CreateFromBox(road_points)
    
    # Add road to bridge
    bridge.append(road)

    # Create railings
    railing_base_height = height + road_thickness
    railing_top_height = railing_base_height + railing_height

    # Left railing
    left_railing_start = Rhino.Geometry.Point3d(0, railing_thickness / 2, railing_base_height)
    left_railing_end = Rhino.Geometry.Point3d(length, railing_thickness / 2, railing_base_height)
    left_railing_line = Rhino.Geometry.Line(left_railing_start, left_railing_end)
    left_railing_midpoint = left_railing_line.PointAt(0.5)
    left_railing = Rhino.Geometry.Cylinder(Rhino.Geometry.Circle(left_railing_midpoint, railing_thickness / 2), railing_height)
    bridge.append(left_railing.ToBrep(True, True))
    
    # Right railing
    right_railing_start = Rhino.Geometry.Point3d(0, width - railing_thickness / 2, railing_base_height)
    right_railing_end = Rhino.Geometry.Point3d(length, width - railing_thickness / 2, railing_base_height)
    right_railing_line = Rhino.Geometry.Line(right_railing_start, right_railing_end)
    right_railing_midpoint = right_railing_line.PointAt(0.5)
    right_railing = Rhino.Geometry.Cylinder(Rhino.Geometry.Circle(right_railing_midpoint, railing_thickness / 2), railing_height)
    bridge.append(right_railing.ToBrep(True, True))

    # Define number of railing segments
    railing_segments = 10
    
    # Calculate the length of each segment
    segment_length = length / railing_segments
    
    # Create railings
    for i in range(railing_segments):
        x = i * segment_length
        
        # Left railing
        left_railing_start = Rhino.Geometry.Point3d(x, railing_thickness / 2, railing_base_height)
        left_railing_end = Rhino.Geometry.Point3d(x + segment_length, railing_thickness / 2, railing_base_height)
        left_railing_line = Rhino.Geometry.Line(left_railing_start, left_railing_end)
        left_railing_midpoint = left_railing_line.PointAt(0.5)
        left_railing = Rhino.Geometry.Cylinder(Rhino.Geometry.Circle(left_railing_midpoint, railing_thickness / 2), railing_height)
        bridge.append(left_railing.ToBrep(True, True))
        
        # Right railing
        right_railing_start = Rhino.Geometry.Point3d(x, width - railing_thickness / 2, railing_base_height)
        right_railing_end = Rhino.Geometry.Point3d(x + segment_length, width - railing_thickness / 2, railing_base_height)
        right_railing_line = Rhino.Geometry.Line(right_railing_start, right_railing_end)
        right_railing_midpoint = right_railing_line.PointAt(0.5)
        right_railing = Rhino.Geometry.Cylinder(Rhino.Geometry.Circle(right_railing_midpoint, railing_thickness / 2), railing_height)
        bridge.append(right_railing.ToBrep(True, True))


    # Return bridge components
    return bridge

# Create a cylinder bridge with railings
bridge = create_cylinder_bridge(length, width, height, divisions, pillar_radius, beam_radius, road_thickness, railing_height, railing_thickness)

# Output the bridge
a = bridge
# ---------- end create_cylinder_bridge_4 ----------
geometry = Geometry(create_box_bridge.a)
geometry_2 = Geometry(create_cylinder_bridge_2.a)
geometry_3 = Geometry(create_cylinder_bridge.a)
geometry_4 = Geometry(create_cylinder_bridge_3.a)
geometry_5 = Geometry(create_cylinder_bridge_4.a)
c_script = CSharpScript()  # -> Out, A
ghpython_script = GhPythonScript()  # -> Out, A
hops = Hops(
    CacheResultsInMemory=True,
    CacheSolveResults=True,
    RemoteSolveVersion=(0, 1, 0),
    ShowInput_Enabled=False,
    ShowInput_Path=False,
    SynchronousSolve=True)

create_cylinder_bridge_5 = GhPythonScript(
    length=Slider(100, range=0..100),
    width=Slider(15.97, range=0..100),
    height=Slider(9.8, range=0..100),
    divisions=Slider(10, range=0..10),
    pillar_radius=Slider(1, range=0..100),
    beam_radius=Slider(0.5, range=0..100),
    road_thickness=Slider(0.5, range=0..100),
    railing_height=Slider(1.72, range=0..3),
    railing_thickness=Slider(0.55, range=0..3),
    catenary_height=Slider(9.12, range=0..10))  # -> out, a; inputs divisions: Int32
# ---------- create_cylinder_bridge_5: Python ----------
import Rhino
import math
import scriptcontext
import rhinoscriptsyntax as rs

def create_cylinder_bridge(length, width, height, divisions, pillar_radius, beam_radius, road_thickness, railing_height, railing_thickness):
    # Calculate division length
    div_length = length / divisions
    
    # Initialize list for bridge components
    bridge = []
    
    # Create cylinders for the bridge
    for i in range(divisions):
        x = i * div_length
        base_point = Rhino.Geometry.Point3d(x, width/2, 0)
        
        # Create cylinder
        base_circle = Rhino.Geometry.Circle(base_point, pillar_radius)
        cylinder = Rhino.Geometry.Cylinder(base_circle, height)
        
        # Add cylinder to bridge
        bridge.append(cylinder.ToBrep(True, True))

        # If it's not the first or last division, create the beam between pillars
        if i > 0:
            start_point = Rhino.Geometry.Point3d(x - div_length, width/2, height)
            end_point = Rhino.Geometry.Point3d(x, width/2, height)
            line = Rhino.Geometry.Line(start_point, end_point)

            # Calculate midpoint of the line
            midpoint = Rhino.Geometry.Point3d((start_point.X + end_point.X) / 2, (start_point.Y + end_point.Y) / 2, (start_point.Z + end_point.Z) / 2)

            beam = Rhino.Geometry.Cylinder(Rhino.Geometry.Circle(midpoint, beam_radius), line.Length)
            
            # Add beam to bridge
            bridge.append(beam.ToBrep(True, True))
    
    # Create the road on the top of the pillars
    road_height = height + road_thickness
    road_base = Rhino.Geometry.Point3d(0, 0, height)
    road_points = [
        Rhino.Geometry.Point3d(road_base[0], road_base[1], road_base[2]),
        Rhino.Geometry.Point3d(road_base[0] + length, road_base[1], road_base[2]),
        Rhino.Geometry.Point3d(road_base[0] + length, road_base[1] + width, road_base[2]),
        Rhino.Geometry.Point3d(road_base[0], road_base[1] + width, road_base[2]),
        Rhino.Geometry.Point3d(road_base[0], road_base[1], road_base[2] + road_thickness),
        Rhino.Geometry.Point3d(road_base[0] + length, road_base[1], road_base[2] + road_thickness),
        Rhino.Geometry.Point3d(road_base[0] + length, road_base[1] + width, road_base[2] + road_thickness),
        Rhino.Geometry.Point3d(road_base[0], road_base[1] + width, road_base[2] + road_thickness),
    ]

    # Create road
    road = Rhino.Geometry.Brep.CreateFromBox(road_points)
    
    # Add road to bridge
    bridge.append(road)

    # Create railings
    railing_base_height = height + road_thickness
    railing_top_height = railing_base_height + railing_height

    # Left railing
    left_railing_start = Rhino.Geometry.Point3d(0, railing_thickness / 2, railing_base_height)
    left_railing_end = Rhino.Geometry.Point3d(length, railing_thickness / 2, railing_base_height)
    left_railing_line = Rhino.Geometry.Line(left_railing_start, left_railing_end)
    left_railing_midpoint = left_railing_line.PointAt(0.5)
    left_railing = Rhino.Geometry.Cylinder(Rhino.Geometry.Circle(left_railing_midpoint, railing_thickness / 2), railing_height)
    bridge.append(left_railing.ToBrep(True, True))
    
    # Right railing
    right_railing_start = Rhino.Geometry.Point3d(0, width - railing_thickness / 2, railing_base_height)
    right_railing_end = Rhino.Geometry.Point3d(length, width - railing_thickness / 2, railing_base_height)
    right_railing_line = Rhino.Geometry.Line(right_railing_start, right_railing_end)
    right_railing_midpoint = right_railing_line.PointAt(0.5)
    right_railing = Rhino.Geometry.Cylinder(Rhino.Geometry.Circle(right_railing_midpoint, railing_thickness / 2), railing_height)
    bridge.append(right_railing.ToBrep(True, True))

    # Define number of railing segments
    railing_segments = 10
    
    # Calculate the length of each segment
    segment_length = length / railing_segments
    
    # Create railings
    for i in range(railing_segments):
        x = i * segment_length
        
        # Left railing
        left_railing_start = Rhino.Geometry.Point3d(x, railing_thickness / 2, railing_base_height)
        left_railing_end = Rhino.Geometry.Point3d(x + segment_length, railing_thickness / 2, railing_base_height)
        left_railing_line = Rhino.Geometry.Line(left_railing_start, left_railing_end)
        left_railing_midpoint = left_railing_line.PointAt(0.5)
        left_railing = Rhino.Geometry.Cylinder(Rhino.Geometry.Circle(left_railing_midpoint, railing_thickness / 2), railing_height)
        bridge.append(left_railing.ToBrep(True, True))
        
        # Right railing
        right_railing_start = Rhino.Geometry.Point3d(x, width - railing_thickness / 2, railing_base_height)
        right_railing_end = Rhino.Geometry.Point3d(x + segment_length, width - railing_thickness / 2, railing_base_height)
        right_railing_line = Rhino.Geometry.Line(right_railing_start, right_railing_end)
        right_railing_midpoint = right_railing_line.PointAt(0.5)
        right_railing = Rhino.Geometry.Cylinder(Rhino.Geometry.Circle(right_railing_midpoint, railing_thickness / 2), railing_height)
        bridge.append(right_railing.ToBrep(True, True))

    import numpy as np
    
    # Create catenary arch cables
    for i in range(divisions - 1):
        x_start = i * div_length
        x_end = (i + 1) * div_length
    
        start_point = Rhino.Geometry.Point3d(x_start, width / 2, height + road_thickness)
        end_point = Rhino.Geometry.Point3d(x_end, width / 2, height + road_thickness)
    
        # Define the catenary scale (adjust this to get desired catenary shape)
        a = 5  # arbitrary value
    
        # Define number of points for each catenary
        num_points = 100
    
        # Create the points for the catenary curve
        x_values = np.linspace(x_start, x_end, num_points)
        y_values = a * np.cosh((x_values - (x_start + x_end) / 2) / a) - a + height + road_thickness
        catenary_points = [Rhino.Geometry.Point3d(x, width / 2, y) for x, y in zip(x_values, y_values)]
    
        # Create the catenary curve
        catenary_curve = Rhino.Geometry.Curve.CreateInterpolatedCurve(catenary_points, 3)
    
        # Add curve to bridge
        bridge.append(catenary_curve.ToNurbsCurve())




    # Return bridge components
    return bridge

# Create a cylinder bridge with railings
bridge = create_cylinder_bridge(length, width, height, divisions, pillar_radius, beam_radius, road_thickness, railing_height, railing_thickness)

# Output the bridge
a = bridge
# ---------- end create_cylinder_bridge_5 ----------
geometry_6 = Geometry(create_cylinder_bridge_5.a)

number_slider_2 = Slider(0.5, range=0..100)
number_slider_3 = Slider(1.72, range=0..3)
number_slider_4 = Slider(9.12, range=0..10)
number_slider_5 = Slider(15.97, range=0..100)
number_slider_6 = Slider(9.8, range=0..100)
number_slider_7 = Slider(10, range=0..10)
number_slider_8 = Slider(1, range=0..100)
number_slider_9 = Slider(0.5, range=0..100)
number_slider_10 = Slider(0.55, range=0..3)
number_slider_11 = Slider(100, range=0..100)
ghpython_script_2 = GhPythonScript()  # -> Out, A
hops_2 = Hops(
    CacheResultsInMemory=True,
    CacheSolveResults=True,
    RemoteSolveVersion=(0, 1, 0),
    ShowInput_Enabled=False,
    ShowInput_Path=False,
    SynchronousSolve=True)
gh_python_remote = GHPythonRemote()  # -> out, linked_modules, rpy, import_statements
c_script_2 = CSharpScript()  # -> Out, A
script_parasite = ScriptParasite(Enable=False, Folder="C:\Users\Sculpture\Desktop\Chatgpt")

number_slider_12 = Slider(1.72, range=0..3)
number_slider_13 = Slider(9.12, range=0..10)
number_slider_14 = Slider(0.5, range=0..100)
number_slider_15 = Slider(100, range=0..100)
number_slider_16 = Slider(15.97, range=0..100)
number_slider_17 = Slider(9.8, range=0..100)
number_slider_18 = Slider(10, range=0..10)
number_slider_19 = Slider(1, range=0..100)
number_slider_20 = Slider(0.5, range=0..100)
number_slider_21 = Slider(0.55, range=0..3)
hops_3 = Hops(
    CacheResultsInMemory=True,
    CacheSolveResults=True,
    RemoteSolveVersion=(0, 1, 0),
    ShowInput_Enabled=False,
    ShowInput_Path=False,
    SynchronousSolve=True)
geometry_7 = Geometry()
param_viewer = ParamViewer()

# ==== cluster GHPythonRemote: Connects the Grasshopper Python component to an external Python instance.
python = PythonScript()  # -> default_working_dir
# ---------- python: Python ----------
from os import path
from Grasshopper.Folders import UserObjectFolders

cluster_comp = ghenv.Component.OnPingDocument().Owner
parent_doc_path = cluster_comp.OnPingDocument().FilePath

if parent_doc_path is not None:
    # Get path to parent GH document
    default_working_dir = path.abspath(path.dirname(parent_doc_path))
else:
    # Fallback to path to user objects default dir
    uo_folder = path.abspath(UserObjectFolders[0])
    if path.isdir(path.join(uo_folder, "gh-python-remote")):
        uo_folder = path.abspath(path.join(uo_folder, "gh-python-remote"))
    default_working_dir = uo_folder
# ---------- end python ----------
# GH to python remote example.
# ⓒ Pierre Cuvilliers, 2017-2022
# Released under the MIT license
# github.com/pilcru/ghpythonremote
# Runs and connects to an external python engine, and
# assigns imported modules to scriptcontext.sticky variables.
# 
# Arguments:
#       code (str): Path to the GH_to_python_sticky.py code file.
#       location (str): Path to a python executable, or to a folder
#             containing `python.exe`, or the name of a conda-created
#             virtual environment prefixed by `conda://` (`conda://env_name`).
#             If empty, finds python from your windows %PATH%.
#       run (boolean): Creates the connection, and imports new
#             modules, when turned to True. Kills the connection,
#             and deletes the references to the imports, when turned
#             to False.
#       modules (str list): List of module names to import in the
#             remote python. They will be added to the
#             scriptcontext.sticky dictionary, allowing them to be
#             reused from other python components in the same
#             Grasshopper document. Submodules (for example
#             `numpy.linalg` have to be added explicitly to this list
#             to be available later.
#       log_level (str from ['NOTSET', 'DEBUG', 'INFO', 'WARNING', 'ERROR', 'CRITICAL']):
#             Logging level to use for the local IronPython and the
#             remote python instance.
#       working_dir (str): Working directory for the remote python
#             instance.
# 
# Returns:
#       out (str): Console output with DEBUG information.
#       linked_modules (str list): list of imported module names.
#       rpy (rpyc connection object): The object representing the
#             remote Python interpreter.
location = ClusterInput()  # location (str): Path to a python executable, or to a folder containing `python.exe`, or the name of a conda-created virtual environment prefixed by `conda://` (`conda://env_name`). If empty, finds python from your windows %PATH%.
run = ClusterInput()  # run (boolean): Creates the connection, and imports new modules, when turned to True. Kills the connection,and deletes the references to the imports, when turned to False.
modules = ClusterInput()  # modules (str list): List of module names to import in the remote python. They will be added to the scriptcontext.sticky dictionary, allowing them to be reused from other python components in the same Grasshopper document. Submodules (for example `numpy.linalg` have to be added explicitly to this list to be available later.
list = ValueList({"CRITICAL", "ERROR", "WARNING", "INFO", "DEBUG", "NOTSET"}, selected="DEBUG")
panel = Panel(python)
ghpythonremote = GHPythonRemote(location=location, run=run, modules=modules, log_level=list, working_dir=panel)  # -> out, linked_modules, rpy; inputs run: Boolean, modules: list
# ---------- ghpythonremote: Python ----------
import inspect
import logging
from os import path
import sys
from time import sleep

import scriptcontext

import ghpythonremote
from ghpythonremote.connectors import GrasshopperToPythonRemote
from Grasshopper.Kernel.GH_RuntimeMessageLevel import Error, Warning

local_log_level = getattr(logging, log_level, logging.WARNING)
logger = logging.getLogger("ghpythonremote")
logger.setLevel(local_log_level)
ch = logging.StreamHandler()
ch.setLevel(local_log_level)
formatter = logging.Formatter("%(levelname)s: %(name)s:\n%(message)s")
ch.setFormatter(formatter)
logger.handlers = []
logger.addHandler(ch)
logger = logging.getLogger("ghpythonremote.GH_to_python")

ROOT = path.abspath(path.dirname(inspect.getfile(ghpythonremote)))
rpyc_server_py = path.join(ROOT, "pythonservice.py")

cluster_comp = ghenv.Component.OnPingDocument().Owner

# Set connection to CLOSED if this is the first run
# and initialize set of linked modules
try:
    remote_python_status
except NameError:
    remote_python_status = "CLOSED"
    lkd_modules = set()

# Wait for connection to connect or terminate
timer = 0
while remote_python_status == "CONNECTING" or remote_python_status == "CLOSING":
    sleep(1)
    timer += 1
    if timer == 10:
        try:
            gh2py_manager.__exit__(*sys.exc_info())
        except Exception:
            pass
        remote_python_status = "CLOSED"
        lkd_modules = set()
        message = (
            "Connection left in an inconsistent state and not returning. Reset "
            "everything."
        )
        if cluster_comp is not None:
            cluster_comp.AddRuntimeMessage(Warning, message)
        raise RuntimeError(message)

if run:
    if not remote_python_status == "OPEN":
        remote_python_status = "CONNECTING"
        gh2py_manager = GrasshopperToPythonRemote(
            rpyc_server_py,
            location=location,
            timeout=10,
            port=None,
            log_level=log_level,
            working_dir=working_dir,
        )
        gh2py = gh2py_manager.__enter__()
        remote_python_status = "OPEN"

    # Stuff that we can reach
    rpymod = gh2py.py_remote_modules  # A getter function for a named python module
    rpy = gh2py.connection  # Represents the remote instance root object
    scriptcontext.sticky["rpy"] = rpy
    # Add modules
    for mod in modules:
        try:
            scriptcontext.sticky[mod] = rpymod(mod)
            lkd_modules.add(mod)
        except ImportError:
            gh2py_manager.__exit__(*sys.exc_info())
            if cluster_comp is not None:
                cluster_comp.AddRuntimeMessage(
                    Error,
                    'Could not import module "{}" in remote Python.'.format(mod)
                )
            raise
        except EOFError:
            if cluster_comp is not None:
                cluster_comp.AddRuntimeMessage(
                    Error,
                    'Remote Python has been closed unexpectedly'
                )
            raise

elif not remote_python_status == "CLOSED":
    remote_python_status = "CLOSING"
    # Remove linked modules
    for mod in lkd_modules:
        del scriptcontext.sticky[mod]
    del scriptcontext.sticky["rpy"]
    gh2py_manager.__exit__(*sys.exc_info())
    lkd_modules = set()
    remote_python_status = "CLOSED"

# Change variable name because ghpython resets outputs to None before each run
linked_modules = lkd_modules

logger.info("GH to python connection is {}".format(remote_python_status))
# ---------- end ghpythonremote ----------
out = ClusterOutput(ghpythonremote.out)  # Console output.
linked_modules = ClusterOutput(ghpythonremote.linked_modules)  # Names of modules that were successfully added to the scriptcontext.sticky dictionary.
rpy = ClusterOutput(ghpythonremote.rpy)  # The object representing the remote python instance
python_2 = PythonScript(module_names=ghpythonremote.linked_modules)  # -> import_statements; inputs module_names: list
# ---------- python_2: Python ----------
import_statements = ["import scriptcontext as sc"]
for module_name in module_names:
    import_statements.append("{0} = sc.sticky['{0}']".format(module_name))

if len(module_names) == 0:
    import_statements = []
# ---------- end python_2 ----------
import_statements = ClusterOutput(python_2)  # Useful import statements to use the imported modules in your scripts.
